# Grasshopper definition main.gh (Grasshopper 1.0.7)
# plug-ins: Human UI, DynaModel_v2

# ---- group: Transitional Motion
button = CreateButton(ButtonName="Transitional Motion", ButtonStyle=0)
adjustpos = AdjustElementPositioning(ElementsToAdjust=button, Margin=Slider(20, range=0..100), AbsolutePositioning=False, Width=Slider(140, range=0..200))

# ----
saved = SavedItems()
panel = Panel(saved)
button_2 = CreateButton(ButtonName="Delete All", ButtonStyle=0)
adjustpos_2 = AdjustElementPositioning(ElementsToAdjust=button_2, AbsolutePositioning=False, Width=Slider(75, range=0..100), Height=Slider(29, range=0..100))
listbox = CreateListBox(ListItems=flatten(panel), SelectedIndex=0, Height=100)
label = CreateLabel(LabelText="Saved Items", LabelSize=12, Justification=0)
values = ValueListener(Elements=button_2, SomeProperty=True)  # -> Values, Indices
values_2 = ValueListener(Elements=listbox, SomeProperty=True)  # -> Values, Indices
merge = Merge(Data1=label, Data2=listbox, Data3=button_2)  # -> flatten(Result)
panel_2 = Panel(values.Values)
deleteitem = DeleteItem(DeleteButton=values.Values, Item=values_2.Values)
panel_3 = Panel(values_2.Values)
viewbox = CreateViewBox(UIElements=merge, Width=Slider(80, range=0..1000), Height=Slider(200, range=0..1000))
separator = CreateSeparator(Thickness=0.5, Horizontal=True, Color=RGB(0, 0, 0))
button_3 = CreateButton(ButtonName="Generate All", ButtonStyle=0)
button_4 = CreateButton(ButtonName="Cancel", ButtonStyle=0)
button_5 = CreateButton(ButtonName="Create model for 3D printer", ButtonStyle=0)
launchwin = LaunchWindow(
    Show=Toggle(True),
    Name="DynaModel",
    Width=Slider(380, range=0..1000),
    Height=400,
    ChildStatus=0,
    EnableHorizScroll=False)

# ---- group: Touch
separator_2 = CreateSeparator(Thickness=0.5, Horizontal=True, Color=RGB(0, 0, 0))
button_6 = CreateButton(ButtonName="Save", ButtonStyle=0)
button_7 = CreateButton(ButtonName="Clear", ButtonStyle=0)
true_button = CreateTrueOnlyButton(ButtonName="Touch", ButtonStyle=0)
tb = CreateTextBlock(Text="Step 1: Press the button to create", TextSize=12, Justification=0)
adjustpos_3 = AdjustElementPositioning(
    ElementsToAdjust=true_button,
    Margin=Slider(20, range=0..100),
    AbsolutePositioning=False,
    Width=Slider(140, range=0..1000))
merge_2 = Merge(Data1=button_6, Data2=button_7)
button_8 = CreateButton(ButtonName="Create", ButtonStyle=0)
values_3 = ValueListener(Elements=true_button, SomeProperty=True)  # -> Values, Indices
stack = CreateStack(UIElements=merge_2, Horizontal=True)
adjustpos_4 = AdjustElementPositioning(
    ElementsToAdjust=button_7,
    Margin=Slider(20, range=0..100),
    AbsolutePositioning=False,
    Width=Slider(140, range=0..1000),
    Height=Slider(30, range=0..100))
adjustpos_5 = AdjustElementPositioning(
    ElementsToAdjust=button_6,
    Margin=Slider(20, range=0..100),
    AbsolutePositioning=False,
    Width=Slider(140, range=0..1000),
    Height=Slider(30, range=0..100))
merge_3 = Merge(Data4=tb, Data5=button_8, Data6=separator_2, Data7=stack)
launchwin_2 = LaunchWindow(Show=values_3.Values, Name="Touch", Width=370, Height=400, ChildStatus=0, EnableHorizScroll=False)
childwin = MakeChildWindow(ParentWindow=launchwin, ChildWindow=launchwin_2)
addelems = AddElements(Window=launchwin_2, Elements=flatten(merge_3), DoVLChecking=True)  # -> AddedElements, ElementNames

# ---- group: Button
separator_3 = CreateSeparator(Thickness=0.5, Horizontal=True, Color=RGB(0, 0, 0))
button_9 = CreateButton(ButtonName="Save", ButtonStyle=0)
button_10 = CreateButton(ButtonName="Clear", ButtonStyle=0)
true_button_2 = CreateTrueOnlyButton(ButtonName="Button", ButtonStyle=0)
tb_2 = CreateTextBlock(Text="Step 1: Press the button to create", TextSize=12, Justification=0)
adjustpos_6 = AdjustElementPositioning(
    ElementsToAdjust=true_button_2,
    Margin=Slider(20, range=0..100),
    AbsolutePositioning=False,
    Width=Slider(140, range=0..1000))
merge_4 = Merge(Data1=button_9, Data2=button_10)
button_11 = CreateButton(ButtonName="Create", ButtonStyle=0)
values_4 = ValueListener(Elements=true_button_2, SomeProperty=True)  # -> Values, Indices
stack_2 = CreateStack(UIElements=merge_4, Horizontal=True)
adjustpos_7 = AdjustElementPositioning(
    ElementsToAdjust=button_10,
    Margin=Slider(20, range=0..100),
    AbsolutePositioning=False,
    Width=Slider(140, range=0..1000),
    Height=Slider(30, range=0..100))
adjustpos_8 = AdjustElementPositioning(
    ElementsToAdjust=button_9,
    Margin=Slider(20, range=0..100),
    AbsolutePositioning=False,
    Width=Slider(140, range=0..1000),
    Height=Slider(30, range=0..100))
launchwin_3 = LaunchWindow(Show=values_4.Values, Name="Button", Width=370, Height=400, ChildStatus=0, EnableHorizScroll=False)
merge_5 = Merge(Data4=tb_2, Data5=button_11, Data6=separator_3, Data7=stack_2)
childwin_2 = MakeChildWindow(ParentWindow=launchwin, ChildWindow=launchwin_3)
addelems_2 = AddElements(Window=launchwin_3, Elements=flatten(merge_5), DoVLChecking=True)  # -> AddedElements, ElementNames

# ---- group: Light
pipe_radius_mm = Slider(3, range=1..6)
true_button_3 = CreateTrueOnlyButton(ButtonName="LED Light", ButtonStyle=0)
adjustpos_9 = AdjustElementPositioning(
    ElementsToAdjust=true_button_3,
    Margin=Slider(20, range=0..100),
    AbsolutePositioning=False,
    Width=Slider(140, range=0..1000))
values_5 = ValueListener(Elements=true_button_3, SomeProperty=True)  # -> Values, Indices
separator_4 = CreateSeparator(Thickness=0.5, Horizontal=True, Color=RGB(0, 0, 0))
separator_5 = CreateSeparator(Thickness=0.5, Horizontal=True, Color=RGB(0, 0, 0))
button_12 = CreateButton(ButtonName="Create", ButtonStyle=0)
tb_3 = CreateTextBlock(Text="Step 2: Design the light outsource and create", TextSize=12, Justification=0)
button_13 = CreateButton(ButtonName="Clear", ButtonStyle=0)
button_14 = CreateButton(ButtonName="Save", ButtonStyle=0)
slider = CreateSlider(Slider=pipe_radius_mm, ShowBounds=False, ShowTicks=False, ShowTooltip=False, ShowValLabel=True, showLabel=True)
adjustpos_10 = AdjustElementPositioning(
    ElementsToAdjust=button_13,
    Margin=Slider(20, range=0..100),
    AbsolutePositioning=False,
    Width=Slider(140, range=0..1000),
    Height=Slider(30, range=0..100))
adjustpos_11 = AdjustElementPositioning(
    ElementsToAdjust=button_14,
    Margin=Slider(20, range=0..100),
    AbsolutePositioning=False,
    Width=Slider(140, range=0..1000),
    Height=Slider(30, range=0..100))
tb_4 = CreateTextBlock(Text="Step 1: Decide the light pipe's parameters", TextSize=12, Justification=0)
label_2 = CreateLabel(LabelText="Inner Pipe Material:", LabelSize=12, Justification=0)
launchwin_4 = LaunchWindow(Show=values_5.Values, Name="LED Light", Width=370, Height=400, ChildStatus=0, EnableHorizScroll=False)
values_6 = ValueListener(Elements=button_12, SomeProperty=True)  # -> Values, Indices
values_7 = ValueListener(Elements=button_14, SomeProperty=True)  # -> Values, Indices
values_8 = ValueListener(Elements=button_13, SomeProperty=True)  # -> Values, Indices
radiobtn = CreateRadioButton(RadioButtonName="Conductive", RadioButtonGroup="Inner Pipe Material", InitiallySelected=Toggle(True))
radiobtn_2 = CreateRadioButton(RadioButtonName="Normal PVC", RadioButtonGroup="Inner Pipe Material", InitiallySelected=False)
merge_6 = Merge(Data1=button_14, Data2=button_13)  # -> flatten(Result)
childwin_3 = MakeChildWindow(ParentWindow=launchwin, ChildWindow=launchwin_4)
createpipe = CreatePipe(StartButton=values_6.Values, InputType="NA", OutputType="LED Light")
merge_7 = Merge(Data1=label_2, Data2=radiobtn, Data3=radiobtn_2)  # -> flatten(Result)
cancel = Cancel(CancelButton=values_8.Values)
save = Save(SaveButton=values_7.Values, Item=createpipe)
stack_3 = CreateStack(UIElements=merge_6, Horizontal=True)
stack_4 = CreateStack(UIElements=merge_7, Horizontal=True)
merge_8 = Merge(
    Data1=tb_4,
    Data2=slider,
    Data3=stack_4,
    Data4=separator_5,
    Data5=tb_3,
    Data6=button_12,
    Data7=separator_4,
    Data8=stack_3)
addelems_3 = AddElements(Window=launchwin_4, Elements=flatten(merge_8), DoVLChecking=True)  # -> AddedElements, ElementNames

# ---- group: Air Pipe
panel_4 = Panel("Air Pipe")
panel_5 = Panel("Step 1: Press the button to create a air pipe to detect humidity and temperature")
separator_6 = CreateSeparator(Thickness=0.5, Horizontal=True, Color=RGB(0, 0, 0))
true_button_4 = CreateTrueOnlyButton(ButtonName=panel_4, ButtonStyle=0)
button_15 = CreateButton(ButtonName="Save", ButtonStyle=0)
button_16 = CreateButton(ButtonName="Clear", ButtonStyle=0)
adjustpos_12 = AdjustElementPositioning(
    ElementsToAdjust=true_button_4,
    Margin=Slider(20, range=0..100),
    AbsolutePositioning=False,
    Width=Slider(140, range=0..1000))
button_17 = CreateButton(ButtonName="Create", ButtonStyle=0)
tb_5 = CreateTextBlock(Text=panel_5, TextSize=12, Justification=0)
values_9 = ValueListener(Elements=true_button_4, SomeProperty=True)  # -> Values, Indices
merge_9 = Merge(Data1=button_15, Data2=button_16)
launchwin_5 = LaunchWindow(Show=values_9.Values, Name=panel_4, Width=370, Height=400, ChildStatus=0, EnableHorizScroll=False)
stack_5 = CreateStack(UIElements=merge_9, Horizontal=True)
adjustpos_13 = AdjustElementPositioning(
    ElementsToAdjust=button_16,
    Margin=Slider(20, range=0..100),
    AbsolutePositioning=False,
    Width=Slider(140, range=0..1000),
    Height=Slider(30, range=0..100))
adjustpos_14 = AdjustElementPositioning(
    ElementsToAdjust=button_15,
    Margin=Slider(20, range=0..100),
    AbsolutePositioning=False,
    Width=Slider(140, range=0..1000),
    Height=Slider(30, range=0..100))
childwin_4 = MakeChildWindow(ParentWindow=launchwin, ChildWindow=launchwin_5)
merge_10 = Merge(Data1=tb_5, Data2=button_17, Data3=separator_6, Data4=stack_5)
addelems_4 = AddElements(Window=launchwin_5, Elements=flatten(merge_10), DoVLChecking=True)  # -> AddedElements, ElementNames

# ----
values_10 = ValueListener(Elements=button_8, SomeProperty=True)  # -> Values, Indices
values_11 = ValueListener(Elements=button_7, SomeProperty=True)  # -> Values, Indices
values_12 = ValueListener(Elements=button_6, SomeProperty=True)  # -> Values, Indices
values_13 = ValueListener(Elements=button_11, SomeProperty=True)  # -> Values, Indices
values_14 = ValueListener(Elements=button_10, SomeProperty=True)  # -> Values, Indices
values_15 = ValueListener(Elements=button_9, SomeProperty=True)  # -> Values, Indices
cancel_2 = Cancel(CancelButton=values_11.Values)
createsimpletouch = CreateSimpleTouch(StartButton=values_10.Values)
cancel_3 = Cancel(CancelButton=values_14.Values)
save_2 = Save(SaveButton=values_12.Values, Item=createsimpletouch)
createsimplebutton = CreateSimpleButton(StartButton=values_13.Values)
save_3 = Save(SaveButton=values_15.Values, Item=createsimplebutton)
values_16 = ValueListener(Elements=button_17, SomeProperty=True)  # -> Values, Indices
createsimplepipe = CreateSimplePipe(StartButton=values_16.Values, InputType="NA", OutputType=panel_4)
values_17 = ValueListener(Elements=button_16, SomeProperty=True)  # -> Values, Indices
values_18 = ValueListener(Elements=button_15, SomeProperty=True)  # -> Values, Indices
save_4 = Save(SaveButton=values_18.Values, Item=createsimplepipe)
cancel_4 = Cancel(CancelButton=values_17.Values)

# ---- group: Rotational
true_button_5 = CreateTrueOnlyButton(ButtonName="Rotational Motion", ButtonStyle=0)
adjustpos_15 = AdjustElementPositioning(
    ElementsToAdjust=true_button_5,
    Margin=Slider(20, range=0..100),
    AbsolutePositioning=False,
    Width=Slider(140, range=0..1000))
values_19 = ValueListener(Elements=true_button_5, SomeProperty=True)  # -> Values, Indices
launchwin_6 = LaunchWindow(Show=values_19.Values, Name="Rotational Motion", Width=370, Height=400, ChildStatus=0, EnableHorizScroll=False)
childwin_5 = MakeChildWindow(ParentWindow=launchwin, ChildWindow=launchwin_6)
thickness = Slider(1, range=0..2)
size = Slider(1, range=0..2)
panel_6 = Panel("Step 1: Create a cutter to cut the model into two part: main model and end effector")
separator_7 = CreateSeparator(Thickness=0.5, Horizontal=True, Color=RGB(0, 0, 0))
tb_6 = CreateTextBlock(Text="Step 2: Scale the cutter", TextSize=12, Justification=0)
slider_2 = CreateSlider(Slider=size, ShowBounds=False, ShowTicks=False, ShowTooltip=False, ShowValLabel=True, showLabel=True)
slider_3 = CreateSlider(Slider=thickness, ShowBounds=False, ShowTicks=False, ShowTooltip=False, ShowValLabel=True, showLabel=True)
button_18 = CreateButton(ButtonName="Clear", ButtonStyle=0)
separator_8 = CreateSeparator(Thickness=0.5, Horizontal=True, Color=RGB(0, 0, 0))
button_19 = CreateButton(ButtonName="Choose", ButtonStyle=0)
tb_7 = CreateTextBlock(Text="Step 3: Choose your end effector", TextSize=12, Justification=0)
tb_8 = CreateTextBlock(Text=panel_6, TextSize=12, Justification=0)
button_20 = CreateButton(ButtonName="Create Cutter", ButtonStyle=0)
separator_9 = CreateSeparator(Thickness=0.5, Horizontal=True, Color=RGB(0, 0, 0))
button_21 = CreateButton(ButtonName="Save", ButtonStyle=0)
adjustpos_16 = AdjustElementPositioning(
    ElementsToAdjust=button_21,
    Margin=Slider(20, range=0..100),
    AbsolutePositioning=False,
    Width=Slider(140, range=0..1000),
    Height=Slider(30, range=0..100))
adjustpos_17 = AdjustElementPositioning(
    ElementsToAdjust=button_18,
    Margin=Slider(20, range=0..100),
    AbsolutePositioning=False,
    Width=Slider(140, range=0..1000),
    Height=Slider(30, range=0..100))
values_20 = ValueListener(Elements=button_18, SomeProperty=True)  # -> Values, Indices
values_21 = ValueListener(Elements=slider_3, SomeProperty=True)  # -> Values, Indices
values_22 = ValueListener(Elements=slider_2, SomeProperty=True)  # -> Values, Indices
values_23 = ValueListener(Elements=button_21, SomeProperty=True)  # -> Values, Indices
values_24 = ValueListener(Elements=button_20, SomeProperty=True)  # -> Values, Indices
merge_11 = Merge(Data1=button_21, Data2=button_18)  # -> flatten(Result)
values_25 = ValueListener(Elements=button_19, SomeProperty=True)  # -> Values, Indices
tbvc = TrueButtonValueController(TrueButtonValue=values_24.Values)
cancel_5 = Cancel(CancelButton=values_20.Values)
stack_6 = CreateStack(UIElements=merge_11, Horizontal=Toggle(True))
cutter = CreateCutter(StartButton=tbvc)
scale = ScaleCutter(Essentials=cutter, ScaleFactor=values_22.Values, Thickness=values_21.Values)
radiobtn_3 = CreateRadioButton(RadioButtonName="Slow", RadioButtonGroup="Gear Speed Group", InitiallySelected=False)
radiobtn_4 = CreateRadioButton(RadioButtonName="Normal", RadioButtonGroup="Gear Speed Group", InitiallySelected=Toggle(True))
radiobtn_5 = CreateRadioButton(RadioButtonName="Fast", RadioButtonGroup="Gear Speed Group", InitiallySelected=False)
values_26 = ValueListener(Elements=radiobtn_4, SomeProperty=True)  # -> Values, Indices
values_27 = ValueListener(Elements=radiobtn_3, SomeProperty=True)  # -> Values, Indices
values_28 = ValueListener(Elements=radiobtn_5, SomeProperty=True)  # -> Values, Indices
radiolistener = RadioButtonListener(Slow=values_27.Values, Normal=values_26.Values, Fast=values_28.Values)
endeffector = ChooseEndEffector(Button=values_25.Values, Essentials=scale, GearSpeed=radiolistener)  # -> ResetButtonValue, SavedItem
save_5 = Save(SaveButton=values_23.Values, Item=endeffector.SavedItem)
merge_12 = Merge(Data1=radiobtn_3, Data2=radiobtn_4, Data3=radiobtn_5)  # -> flatten(Result)
stack_7 = CreateStack(UIElements=merge_12, Horizontal=True)
merge_13 = Merge(
    Data1=tb_8,
    Data2=button_20,
    Data3=separator_9,
    Data4=tb_6,
    Data5=slider_2,
    Data6=slider_3,
    Data7=separator_7,
    Data8=tb_7,
    Data9=stack_7,
    Data10=button_19,
    Data11=separator_8,
    Data12=stack_6)
addelems_5 = AddElements(Window=launchwin_6, Elements=flatten(merge_13), DoVLChecking=True)  # -> AddedElements, ElementNames

# ----
merge_14 = Merge(Data2=true_button)  # -> flatten(Result)
merge_15 = Merge(Data1=true_button_2, Data2=true_button)  # -> flatten(Result)
stack_8 = CreateStack(UIElements=merge_14, Horizontal=Toggle(True))
stack_9 = CreateStack(UIElements=merge_15, Horizontal=Toggle(True))
merge_16 = Merge(Data1=true_button_3, Data2=true_button_4)  # -> flatten(Result)
merge_17 = Merge(Data1=true_button_5, Data2=button)  # -> flatten(Result)
stack_10 = CreateStack(UIElements=merge_16, Horizontal=Toggle(True))
stack_11 = CreateStack(UIElements=merge_17, Horizontal=Toggle(True))
merge_18 = Merge(Data1=stack_11, Data2=stack_10, Data3=stack_8, Data4=stack_9)  # -> flatten(Result)
viewbox_2 = CreateViewBox(UIElements=merge_18, Width=Slider(279, range=0..1000), Height=Slider(292, range=0..1000))
merge_19 = Merge(Data1=viewbox, Data2=viewbox_2)  # -> flatten(Result)
stack_12 = CreateStack(UIElements=merge_19, Horizontal=True)
merge_20 = Merge(Data1=button_3, Data2=button_4)
stack_13 = CreateStack(UIElements=merge_20, Horizontal=True)
adjustpos_18 = AdjustElementPositioning(
    ElementsToAdjust=button_4,
    Margin=Slider(20, range=0..100),
    AbsolutePositioning=False,
    Width=Slider(140, range=0..1000),
    Height=Slider(30, range=0..100))
adjustpos_19 = AdjustElementPositioning(
    ElementsToAdjust=button_3,
    Margin=Slider(20, range=0..100),
    AbsolutePositioning=False,
    Width=Slider(140, range=0..1000),
    Height=Slider(30, range=0..100))
separator_10 = CreateSeparator(Thickness=0.5, Horizontal=True, Color=RGB(0, 0, 0))
values_29 = ValueListener(Elements=button_3, SomeProperty=True)  # -> Values, Indices
merge_21 = Merge(Data1=stack_12, Data2=separator_10, Data3=stack_13, Data4=separator, Data5=button_5)
addelems_6 = AddElements(Window=launchwin, Elements=flatten(merge_21), DoVLChecking=True)  # -> AddedElements, ElementNames
nickname = Generate(GenerateButton=values_29.Values)
